# Grasshopper definition SimpleBeams.gh (Grasshopper 0.9.76)
# plug-ins: GuanacoComponents

# ----
# Prepare the geometry
panel = Panel("100")
multiplication = Multiplication(A=panel, B=-0.5)
multiplication_2 = Multiplication(A=panel, B=0.5)
pt = ConstructPoint(XCoordinate=multiplication, YCoordinate=0, ZCoordinate=0)
pt_2 = ConstructPoint(XCoordinate=multiplication_2, YCoordinate=0, ZCoordinate=0)
avr = Average(Input=[pt, pt_2])

# ----
# Set Gmsh & CCX path
# (otherwise GH libraries scanned)
panel_2 = Panel("yourCCXDirectory\ccx.exe")
ccxpath = CCXPath(Path=panel_2)
gmshpath = GmshPath(Path="yourGmshDirectory\gmsh.exe")

# ----
# Create a bar
panel_3 = Panel("StandardMaterials")
searchlibrary = SearchLibrary(LibraryName=panel_3, Item="Steel")
boxprofile = BoxProfile(Name="1x1Box", Height="1", Width="1", Thickness=0)
ln = Line(StartPoint=pt, EndPoint=pt_2)
createbar = CreateBar(Curve=ln, Profile=boxprofile, Material=searchlibrary, Rotation=0, XOffset=0, YOffset=0)

# ----
# Create simple supports
supporttype = SupportType({"DX": 1, "DY": 2, "DZ": 3, "RX": 4, "RY": 5, "RZ": 6, "FP": 7}, selected=["DX", "DY", "DZ"])
support = Support(Geometry=flatten([pt, pt_2]), SupportType=supporttype, SupportName="Support")

# ----
# Create fixed supports
supporttype_2 = SupportType({"DX": 1, "DY": 2, "DZ": 3, "RX": 4, "RY": 5, "RZ": 6, "FP": 7}, selected=["DX", "DY", "DZ", "RX", "RY", "RZ"])
support_2 = Support(Geometry=flatten([pt, pt_2]), SupportType=supporttype_2, SupportName="Support")

# ----
# Create nodal force
panel_4 = Panel("-1000")
Z = UnitZ(Factor=panel_4)
nodalforce = NodalForce(Point=avr, Force=Z)

# ----
# Create nodal moment
panel_5 = Panel("1000")
Y = UnitY(Factor=1)
nodalmoment = NodalMoment(Point=avr, Axis=Y, Moment=panel_5)

# ----
# Create model
panel_6 = Panel("SimpleBeam")
buildmodel = BuildModel(Name=panel_6, Components=createbar, Tolerance="0.1")

# ----
# Mesh the model
meshalgorithm = MeshAlgorithm({"MeshAdapt": 1, "Automatic": 2, "Delaunay": 5, "Frontal": 6, "Bamg": 7, "DelQuad": 8, "Pack": 9}, selected="DelQuad")
element2dshape = Element2DShape({"Tri": 0, "Quad": 1}, selected="Quad")
toggle = BooleanToggle(True)
gmshparams = GmshParams(
    ElementShape=element2dshape,
    MeshingAlgorithm=meshalgorithm,
    MaximumCharacteristicEdgeLength="5",
    SecondOrderElements=Toggle(True),
    NumberOfSmoothingSteps="5",
    HighOrderOptimizationIfTrue=Toggle(False),
    OptimizationThreshold="0",
    UnifyFaceNormalsIfTrue=True)
gmshelements = GmshElements(
    RunMeshingProcess=Toggle(False),
    Model=buildmodel,
    GmshParameters=gmshparams,
    ReducedIntegrationElementsAreCreatedIfTrue=Toggle(True))

# ----
# Set BC's
setbcs = SetBCs(Model=gmshelements, Loads=nodalforce, Supports=support)

# ----
# Set BC's
setbcs_2 = SetBCs(Model=gmshelements, Loads=nodalforce, Supports=support_2)

# ----
# Preview the model
number_slider = Slider(1, range=0..5)
modelpreview = ModelPreview(
    Model=setbcs_2,
    PreviewNodes=Toggle(True),
    PreviewThickness=Toggle(False),
    PreviewEdges=Toggle(False),
    PreviewLCS=Toggle(False),
    PreviewLoads=Toggle(True),
    PreviewSupports=Toggle(False),
    PreviewComponentNumbers=Toggle(False),
    PreviewNodeNumbers=Toggle(False),
    PreviewElementNumbers=Toggle(False),
    PreviewLoadValues=Toggle(True),
    TextSizeFactor=number_slider,
    GraphicSizeFactor=Slider(1, range=0..1))

# ----
# Set BC's
setbcs_3 = SetBCs(Model=gmshelements, Loads=nodalmoment, Supports=support_2)

# ----
# Preview the model
number_slider_2 = Slider(1, range=0..5)
modelpreview_2 = ModelPreview(
    Model=setbcs_3,
    PreviewNodes=Toggle(True),
    PreviewThickness=Toggle(False),
    PreviewEdges=Toggle(False),
    PreviewLCS=Toggle(False),
    PreviewLoads=Toggle(True),
    PreviewSupports=Toggle(True),
    PreviewComponentNumbers=Toggle(False),
    PreviewNodeNumbers=Toggle(False),
    PreviewElementNumbers=Toggle(False),
    PreviewLoadValues=Toggle(True),
    TextSizeFactor=number_slider_2,
    GraphicSizeFactor=Slider(1, range=0..1))

# ----
# Preview the model
number_slider_3 = Slider(1, range=0..5)
modelpreview_3 = ModelPreview(
    Model=setbcs,
    PreviewNodes=Toggle(True),
    PreviewThickness=Toggle(False),
    PreviewEdges=Toggle(False),
    PreviewLCS=Toggle(True),
    PreviewLoads=Toggle(True),
    PreviewSupports=Toggle(False),
    PreviewComponentNumbers=Toggle(False),
    PreviewNodeNumbers=Toggle(False),
    PreviewElementNumbers=Toggle(False),
    PreviewLoadValues=Toggle(True),
    TextSizeFactor=number_slider_3,
    GraphicSizeFactor=Slider(1, range=0..1))

# ----
# Run the analysis
toggle_2 = BooleanToggle(True)
ccxsolvemodel = CCXSolveModel(Run=Toggle(False), Model=setbcs, Nonlinear=toggle_2, Threads=4)

# ----
# Run the analysis
toggle_3 = BooleanToggle(True)
ccxsolvemodel_2 = CCXSolveModel(Run=Toggle(False), Model=setbcs_2, Nonlinear=toggle_3, Threads=4)

# ----
# Run the analysis
toggle_4 = BooleanToggle(True)
ccxsolvemodel_3 = CCXSolveModel(Run=Toggle(False), Model=setbcs_3, Nonlinear=toggle_4, Threads=4)

# ----
# Preview the results
_0dresulttype = _0DResultType({"None": 0, "dX": 1, "dY": 2, "dZ": 3, "dTotal": 4}, selected="None")
_1dresulttype = _1DResultType({"None": 0, "Fx": 1, "Fy": 2, "Fz": 3, "Mxx": 4, "Myy": 5, "Mzz": 6}, selected="Myy")
_2dresulttype = _2DResultType({"None": 0, "Sxx": 1, "Syy": 2, "Szz": 3, "Sxy": 4, "Sxz": 5, "Syz": 6, "Exx": 1, "Eyy": 2, "Ezz": 3, "Exy": 4, "Exz": 5, "Eyz": 6}, selected="None")
resultpreview = ResultPreview(
    Model=ccxsolvemodel,
    NodeResultType=_0dresulttype,
    BarResultType=_1dresulttype,
    PanelResultType=_2dresulttype,
    PreviewValues=Toggle(True),
    PreviewNodes=Toggle(False),
    PreviewEdges=Toggle(False),
    Deformed=Toggle(True),
    PreviewLCS=Toggle(False),
    PreviewLoads=Toggle(False),
    PreviewSupports=Toggle(False),
    PreviewComponentNumbers=Toggle(False),
    PreviewNodeNumbers=Toggle(False),
    PreviewElementNumbers=Toggle(False),
    PreviewLoadValues=Toggle(False),
    TextSizeFactor="1",
    GraphicSizeFactor="1",
    DeformationFactor="10000")

# ----
# Preview the results
_0dresulttype_2 = _0DResultType({"None": 0, "dX": 1, "dY": 2, "dZ": 3, "dTotal": 4}, selected="None")
_1dresulttype_2 = _1DResultType({"None": 0, "Fx": 1, "Fy": 2, "Fz": 3, "Mxx": 4, "Myy": 5, "Mzz": 6}, selected="Myy")
_2dresulttype_2 = _2DResultType({"None": 0, "Sxx": 1, "Syy": 2, "Szz": 3, "Sxy": 4, "Sxz": 5, "Syz": 6, "Exx": 1, "Eyy": 2, "Ezz": 3, "Exy": 4, "Exz": 5, "Eyz": 6}, selected="None")
resultpreview_2 = ResultPreview(
    Model=ccxsolvemodel_2,
    NodeResultType=_0dresulttype_2,
    BarResultType=_1dresulttype_2,
    PanelResultType=_2dresulttype_2,
    PreviewValues=Toggle(True),
    PreviewNodes=Toggle(False),
    PreviewEdges=Toggle(False),
    Deformed=Toggle(True),
    PreviewLCS=Toggle(False),
    PreviewLoads=Toggle(False),
    PreviewSupports=Toggle(False),
    PreviewComponentNumbers=Toggle(False),
    PreviewNodeNumbers=Toggle(False),
    PreviewElementNumbers=Toggle(False),
    PreviewLoadValues=Toggle(False),
    TextSizeFactor="1",
    GraphicSizeFactor="1",
    DeformationFactor="10000")

# ----
# Preview the results
_0dresulttype_3 = _0DResultType({"None": 0, "dX": 1, "dY": 2, "dZ": 3, "dTotal": 4}, selected="None")
_1dresulttype_3 = _1DResultType({"None": 0, "Fx": 1, "Fy": 2, "Fz": 3, "Mxx": 4, "Myy": 5, "Mzz": 6}, selected="Myy")
_2dresulttype_3 = _2DResultType({"None": 0, "Sxx": 1, "Syy": 2, "Szz": 3, "Sxy": 4, "Sxz": 5, "Syz": 6, "Exx": 1, "Eyy": 2, "Ezz": 3, "Exy": 4, "Exz": 5, "Eyz": 6}, selected="None")
resultpreview_3 = ResultPreview(
    Model=ccxsolvemodel_3,
    NodeResultType=_0dresulttype_3,
    BarResultType=_1dresulttype_3,
    PanelResultType=_2dresulttype_3,
    PreviewValues=Toggle(True),
    PreviewNodes=Toggle(False),
    PreviewEdges=Toggle(False),
    Deformed=Toggle(True),
    PreviewLCS=Toggle(False),
    PreviewLoads=Toggle(False),
    PreviewSupports=Toggle(False),
    PreviewComponentNumbers=Toggle(False),
    PreviewNodeNumbers=Toggle(False),
    PreviewElementNumbers=Toggle(False),
    PreviewLoadValues=Toggle(False),
    TextSizeFactor="1",
    GraphicSizeFactor="1",
    DeformationFactor="1000000")
