# Grasshopper definition SimpleBuilding.gh (Grasshopper 0.9.76)
# plug-ins: GuanacoComponents

# ----
# Set Gmsh & CCX path
# (otherwise GH libraries scanned)
panel = Panel("yourCCXDirectory\ccx.exe")
ccxpath = CCXPath(Path=panel)
gmshpath = GmshPath(Path="yourGmshDirectory\gmsh.exe")

# ----
# Storeys
panel_2 = Panel("10")

# ----
# Core plan
panel_3 = Panel("8")

# ----
# Floor plan
panel_4 = Panel("16")

# ----
# Columns per edge
panel_5 = Panel("3")

rectangle = Rectangle(Plane=PlaneXY(0, 0, 0), XSize="5", YSize=panel_3, Radius=0)  # -> Rectangle, Length
rectangle_2 = Rectangle(Plane=PlaneXY(0, 0, 0), XSize=panel_4, YSize="20", Radius=0)  # -> Rectangle, Length
Z = UnitZ(Factor=1)
multiplication = Multiplication(A=panel_2, B="4")
division = Division(A=1, B=panel_5)
area = Area(Geometry=rectangle.Rectangle)  # -> Area, Centroid
area_2 = Area(Geometry=rectangle_2.Rectangle)  # -> Area, Centroid
multiplication_2 = Multiplication(A=Z, B=multiplication)
series = Series(Start=0, Step=division, Count=panel_5)
vec2pt = Vector2Pt(PointA=area_2.Centroid, PointB=area.Centroid, Unitize=False)  # -> Vector, Length
move = Move(Geometry=rectangle_2.Rectangle, Motion=vec2pt.Vector)  # -> Geometry, Transform
series_2 = Series(Start="4", Step="4", Count=panel_2)
explode = Explode(Curve=move.Geometry, Recursive=True)  # -> Segments, Vertices
Z_2 = UnitZ(Factor=series_2)
eval = EvaluateLength(Curve=graft(explode.Segments), Length=series, Normalized=True)  # -> flatten(Point), Tangent, Parameter
boundary = BoundarySurfaces(Edges=move.Geometry)
move_2 = Move(Geometry=eval.Point, Motion=multiplication_2)  # -> Geometry, Transform

# ----
# Load the materials
panel_6 = Panel("StandardMaterials")
searchlibrary = SearchLibrary(LibraryName=panel_6, Item="Steel")
searchlibrary_2 = SearchLibrary(LibraryName="StandardMaterials", Item="Concrete")

# ----
# Core
extr = Extrude(Base=rectangle.Rectangle, Direction=multiplication_2)

# ----
# Floors
move_3 = Move(Geometry=boundary, Motion=Z_2)  # -> Geometry, Transform

# ----
# Columns
ln = Line(StartPoint=eval.Point, EndPoint=move_2.Geometry)

# ----
# Create a panel
fe2dtype = FE2DType({"Shell": 0, "Membrane": 1, "PlaneStress": 2, "PlaneStrain": 3}, selected="Shell")
createpanel = CreatePanel(Surface=move_3.Geometry, Thickness="0.25", Material=searchlibrary_2, FEType=fe2dtype)  # -> flatten(Panel)

# ----
# Create a bar
panel_7 = Panel("Box0.2x0.2x0.01")
boxprofile = BoxProfile(Name=panel_7, Height="0.2", Width="0.2", Thickness="0.01")
createbar = CreateBar(Curve=ln, Profile=boxprofile, Material=searchlibrary, Rotation=0, XOffset=0, YOffset=0)  # -> flatten(Bar)

# ----
# Create a panel
fe2dtype_2 = FE2DType({"Shell": 0, "Membrane": 1, "PlaneStress": 2, "PlaneStrain": 3}, selected="Shell")
createpanel_2 = CreatePanel(Surface=extr, Thickness="0.4", Material=searchlibrary_2, FEType=fe2dtype_2)  # -> flatten(Panel)

# ----
# Create simple supports
supporttype = SupportType({"DX": 1, "DY": 2, "DZ": 3, "RX": 4, "RY": 5, "RZ": 6, "FP": 7}, selected=["DX", "DY", "DZ"])
support = Support(Geometry=flatten([rectangle.Rectangle, eval.Point]), SupportType=supporttype, SupportName="Support")

# ----
# Create model
panel_8 = Panel("SimpleBuilding")
buildmodel = BuildModel(Name=panel_8, Components=flatten([createpanel_2, createpanel, createbar]), Tolerance="0.1")

# ----
# Mesh the model
meshalgorithm = MeshAlgorithm({"MeshAdapt": 1, "Automatic": 2, "Delaunay": 5, "Frontal": 6, "Bamg": 7, "DelQuad": 8, "Pack": 9}, selected="Automatic")
element2dshape = Element2DShape({"Tri": 0, "Quad": 1}, selected="Quad")
gmshparams = GmshParams(
    ElementShape=element2dshape,
    MeshingAlgorithm=meshalgorithm,
    MaximumCharacteristicEdgeLength="1",
    SecondOrderElements=Toggle(True),
    NumberOfSmoothingSteps="5",
    HighOrderOptimizationIfTrue=Toggle(False),
    OptimizationThreshold="0",
    UnifyFaceNormalsIfTrue=Toggle(True))
gmshmodel = GmshModel(
    RunMeshingProcess=Toggle(False),
    Model=buildmodel,
    GmshParameters=gmshparams,
    ReducedIntegrationElementsAreCreatedIfTrue=Toggle(True))

toghmesh = ToGHMesh(GuanacoMesh=gmshmodel)
explode_2 = Explode(Curve=move.Geometry, Recursive=True)  # -> Segments, Vertices
item = ListItem(List=explode_2.Segments, Index=0, Wrap=True)
mesh = Mesh(toghmesh)
extr_2 = Extrude(Base=item, Direction=multiplication_2)
clean = CleanTree(RemoveNulls=True, RemoveInvalid=True, RemoveEmpty=False, Tree=mesh)
demesh = DeconstructMesh(Mesh=clean)  # -> Vertices, Faces, Colours, Normals
pull = PullPoint(Point=demesh.Vertices, Geometry=extr_2, ClosestOnly=True)  # -> ClosestPoint, Distance
smaller = SmallerThan(FirstNumber=pull.Distance, SecondNumber=0.001)  # -> SmallerThan, OrEqualTo
cull = CullPattern(List=demesh.Vertices, CullPattern=smaller.SmallerThan)

# ----
# Create gravity
panel_9 = Panel("-1")
Z_3 = UnitZ(Factor=panel_9)
gravityload = GravityLoad(LoadValue=Z_3)

# ----
# Create nodal forces
panel_10 = Panel("100")
Y = UnitY(Factor=panel_10)
nodalforce = NodalForce(Point=cull, Force=Y)

# ----
# Create floor load
panel_11 = Panel("-5")
pressureload = PressureLoad(Surfaces=move_3.Geometry, LoadValue=panel_11)

# ----
# Set BC's
setbcs = SetBCs(Model=gmshmodel, Loads=flatten([nodalforce, gravityload, pressureload]), Supports=support)

# ----
# Preview the model
number_slider = Slider(1, range=0..5)
modelpreview = ModelPreview(
    Model=setbcs,
    PreviewNodes=Toggle(False),
    PreviewThickness=Toggle(True),
    PreviewEdges=Toggle(True),
    PreviewLCS=Toggle(False),
    PreviewLoads=Toggle(True),
    PreviewSupports=Toggle(True),
    PreviewComponentNumbers=Toggle(False),
    PreviewNodeNumbers=Toggle(True),
    PreviewElementNumbers=Toggle(True),
    PreviewLoadValues=Toggle(True),
    TextSizeFactor=number_slider,
    GraphicSizeFactor=Slider(1, range=0..1))

# ----
# Run the analysis
toggle = BooleanToggle(False)
ccxsolvemodel = CCXSolveModel(Run=Toggle(False), Model=setbcs, Nonlinear=toggle, Threads=4)

# ----
# Preview the results
_0dresulttype = _0DResultType({"None": 0, "dX": 1, "dY": 2, "dZ": 3, "dTotal": 4}, selected="dZ")
_1dresulttype = _1DResultType({"None": 0, "Fx": 1, "Fy": 2, "Fz": 3, "Mxx": 4, "Myy": 5, "Mzz": 6}, selected="None")
_2dresulttype = _2DResultType({"None": 0, "Sxx": 1, "Syy": 2, "Szz": 3, "Sxy": 4, "Sxz": 5, "Syz": 6, "Exx": 1, "Eyy": 2, "Ezz": 3, "Exy": 4, "Exz": 5, "Eyz": 6}, selected="Szz")
resultpreview = ResultPreview(
    Model=ccxsolvemodel,
    NodeResultType=_0dresulttype,
    BarResultType=_1dresulttype,
    PanelResultType=_2dresulttype,
    PreviewValues=Toggle(False),
    PreviewNodes=Toggle(False),
    PreviewEdges=Toggle(True),
    Deformed=Toggle(True),
    PreviewLCS=Toggle(False),
    PreviewLoads=Toggle(False),
    PreviewSupports=Toggle(False),
    PreviewComponentNumbers=Toggle(False),
    PreviewNodeNumbers=Toggle(False),
    PreviewElementNumbers=Toggle(False),
    PreviewLoadValues=Toggle(False),
    TextSizeFactor="1",
    GraphicSizeFactor="10",
    DeformationFactor="100000")
