# Grasshopper definition SimplePanels.gh (Grasshopper 0.9.76)
# plug-ins: GuanacoComponents

# ----
# Set Gmsh & CCX path
# (otherwise GH libraries scanned)
panel = Panel("yourCCXDirectory\ccx.exe")
ccxpath = CCXPath(Path=panel)
gmshpath = GmshPath(Path="yourGmshDirectory\gmsh.exe")

# ----
# Prepare the geometry
panel_2 = Panel("100")
multiplication = Multiplication(A=panel_2, B=-0.5)
multiplication_2 = Multiplication(A=panel_2, B=0.5)

addition = Addition(A=multiplication_2, B="0.1")
addition_2 = Addition(A=multiplication, B="0.1")

pt = ConstructPoint(XCoordinate=addition, YCoordinate=addition, ZCoordinate=0)
pt_2 = ConstructPoint(XCoordinate=addition_2, YCoordinate=addition_2, ZCoordinate=0)
avr = Average(Input=[pt_2, pt])
rec_2pt = Rectangle2Pt(Plane=PlaneXY(0, 0, 0), PointA=pt_2, PointB=pt, Radius=0)  # -> Rectangle, Length

# ----
# Create a panel
panel_3 = Panel("StandardMaterials")
fe2dtype = FE2DType({"Shell": 0, "Membrane": 1, "PlaneStress": 2, "PlaneStrain": 3}, selected="Shell")
boundary = BoundarySurfaces(Edges=rec_2pt.Rectangle)
searchlibrary = SearchLibrary(LibraryName=panel_3, Item="Steel")
createpanel = CreatePanel(Surface=boundary, Thickness="0.1", Material=searchlibrary, FEType=fe2dtype)

# ----
# Create a panel
panel_4 = Panel("StandardMaterials")
fe2dtype_2 = FE2DType({"Shell": 0, "Membrane": 1, "PlaneStress": 2, "PlaneStrain": 3}, selected="Membrane")
boundary_2 = BoundarySurfaces(Edges=rec_2pt.Rectangle)
searchlibrary_2 = SearchLibrary(LibraryName=panel_4, Item="Steel")
createpanel_2 = CreatePanel(Surface=boundary_2, Thickness="0.1", Material=searchlibrary_2, FEType=fe2dtype_2)

# ----
# Create simple supports
supporttype = SupportType({"DX": 1, "DY": 2, "DZ": 3, "RX": 4, "RY": 5, "RZ": 6, "FP": 7}, selected=["DX", "DY", "DZ"])
support = Support(Geometry=flatten(rec_2pt.Rectangle), SupportType=supporttype, SupportName="Support")

# ----
# Create nodal force
panel_5 = Panel("-5000")
Z = UnitZ(Factor=panel_5)
nodalforce = NodalForce(Point=avr, Force=Z)

# ----
# Create model
panel_6 = Panel("SimplePanel")
buildmodel = BuildModel(Name=panel_6, Components=createpanel, Tolerance="0.1")

# ----
# Create model
panel_7 = Panel("SimpleMembrane")
buildmodel_2 = BuildModel(Name=panel_7, Components=createpanel_2, Tolerance="0.1")

# ----
# Mesh the model
meshalgorithm = MeshAlgorithm({"MeshAdapt": 1, "Automatic": 2, "Delaunay": 5, "Frontal": 6, "Bamg": 7, "DelQuad": 8, "Pack": 9}, selected="DelQuad")
element2dshape = Element2DShape({"Tri": 0, "Quad": 1}, selected="Quad")
gmshparams = GmshParams(
    ElementShape=element2dshape,
    MeshingAlgorithm=meshalgorithm,
    MaximumCharacteristicEdgeLength="5",
    SecondOrderElements=Toggle(True),
    NumberOfSmoothingSteps="5",
    HighOrderOptimizationIfTrue=Toggle(False),
    OptimizationThreshold="0",
    UnifyFaceNormalsIfTrue=Toggle(True))
gmshmodel = GmshModel(
    RunMeshingProcess=Toggle(False),
    Model=buildmodel,
    GmshParameters=gmshparams,
    ReducedIntegrationElementsAreCreatedIfTrue=Toggle(True))

# ----
# Mesh the model
meshalgorithm_2 = MeshAlgorithm({"MeshAdapt": 1, "Automatic": 2, "Delaunay": 5, "Frontal": 6, "Bamg": 7, "DelQuad": 8, "Pack": 9}, selected="DelQuad")
element2dshape_2 = Element2DShape({"Tri": 0, "Quad": 1}, selected="Quad")
gmshparams_2 = GmshParams(
    ElementShape=element2dshape_2,
    MeshingAlgorithm=meshalgorithm_2,
    MaximumCharacteristicEdgeLength="5",
    SecondOrderElements=Toggle(True),
    NumberOfSmoothingSteps="5",
    HighOrderOptimizationIfTrue=Toggle(False),
    OptimizationThreshold="0",
    UnifyFaceNormalsIfTrue=Toggle(True))
gmshmodel_2 = GmshModel(
    RunMeshingProcess=Toggle(True),
    Model=buildmodel_2,
    GmshParameters=gmshparams_2,
    ReducedIntegrationElementsAreCreatedIfTrue=Toggle(True))

# ----
# Set BC's
setbcs = SetBCs(Model=gmshmodel, Loads=nodalforce, Supports=support)

# ----
# Set BC's
setbcs_2 = SetBCs(Model=gmshmodel_2, Loads=nodalforce, Supports=support)

# ----
# Preview the model
number_slider = Slider(1, range=0..5)
modelpreview = ModelPreview(
    Model=setbcs,
    PreviewNodes=Toggle(False),
    PreviewThickness=Toggle(False),
    PreviewEdges=Toggle(True),
    PreviewLCS=Toggle(False),
    PreviewLoads=Toggle(True),
    PreviewSupports=Toggle(True),
    PreviewComponentNumbers=Toggle(False),
    PreviewNodeNumbers=Toggle(True),
    PreviewElementNumbers=Toggle(True),
    PreviewLoadValues=Toggle(True),
    TextSizeFactor=number_slider,
    GraphicSizeFactor=Slider(1, range=0..1))

# ----
# Preview the model
number_slider_2 = Slider(1, range=0..5)
modelpreview_2 = ModelPreview(
    Model=setbcs_2,
    PreviewNodes=Toggle(False),
    PreviewThickness=Toggle(False),
    PreviewEdges=Toggle(True),
    PreviewLCS=Toggle(False),
    PreviewLoads=Toggle(True),
    PreviewSupports=Toggle(True),
    PreviewComponentNumbers=Toggle(False),
    PreviewNodeNumbers=Toggle(True),
    PreviewElementNumbers=Toggle(True),
    PreviewLoadValues=Toggle(True),
    TextSizeFactor=number_slider_2,
    GraphicSizeFactor=Slider(1, range=0..1))

# ----
# Run the analysis
toggle = BooleanToggle(True)
ccxsolvemodel = CCXSolveModel(Run=Toggle(False), Model=setbcs, Nonlinear=toggle, Threads=4)

# ----
# Run the analysis
toggle_2 = BooleanToggle(False)
# MEMBRANE ELEMENTS
# NOT IMPLEMENTED IN CCX 2.12
# NEED TO RECOMPILE CCX 2.14
toggle_3 = BooleanToggle(False)
ccxsolvemodel_2 = CCXSolveModel(Run=toggle_3, Model=setbcs_2, Nonlinear=toggle_2, Threads=4)

# ----
# Preview the results
_0dresulttype = _0DResultType({"None": 0, "dX": 1, "dY": 2, "dZ": 3, "dTotal": 4}, selected="None")
_1dresulttype = _1DResultType({"None": 0, "Fx": 1, "Fy": 2, "Fz": 3, "Mxx": 4, "Myy": 5, "Mzz": 6}, selected="None")
_2dresulttype = _2DResultType({"None": 0, "Sxx": 1, "Syy": 2, "Szz": 3, "Sxy": 4, "Sxz": 5, "Syz": 6, "Exx": 1, "Eyy": 2, "Ezz": 3, "Exy": 4, "Exz": 5, "Eyz": 6}, selected="Sxx")
resultpreview = ResultPreview(
    Model=ccxsolvemodel,
    NodeResultType=_0dresulttype,
    BarResultType=_1dresulttype,
    PanelResultType=_2dresulttype,
    PreviewValues=Toggle(False),
    PreviewNodes=Toggle(False),
    PreviewEdges=Toggle(True),
    Deformed=Toggle(True),
    PreviewLCS=Toggle(False),
    PreviewLoads=Toggle(False),
    PreviewSupports=Toggle(False),
    PreviewComponentNumbers=Toggle(False),
    PreviewNodeNumbers=Toggle(False),
    PreviewElementNumbers=Toggle(False),
    PreviewLoadValues=Toggle(False),
    TextSizeFactor="1",
    GraphicSizeFactor="1",
    DeformationFactor="10000000")

# ----
# Preview the results
_0dresulttype_2 = _0DResultType({"None": 0, "dX": 1, "dY": 2, "dZ": 3, "dTotal": 4}, selected="None")
_1dresulttype_2 = _1DResultType({"None": 0, "Fx": 1, "Fy": 2, "Fz": 3, "Mxx": 4, "Myy": 5, "Mzz": 6}, selected="Myy")
_2dresulttype_2 = _2DResultType({"None": 0, "Sxx": 1, "Syy": 2, "Szz": 3, "Sxy": 4, "Sxz": 5, "Syz": 6, "Exx": 1, "Eyy": 2, "Ezz": 3, "Exy": 4, "Exz": 5, "Eyz": 6}, selected="None")
resultpreview_2 = ResultPreview(
    Model=ccxsolvemodel_2,
    NodeResultType=_0dresulttype_2,
    BarResultType=_1dresulttype_2,
    PanelResultType=_2dresulttype_2,
    PreviewValues=Toggle(True),
    PreviewNodes=Toggle(False),
    PreviewEdges=Toggle(True),
    Deformed=Toggle(True),
    PreviewLCS=Toggle(False),
    PreviewLoads=Toggle(False),
    PreviewSupports=Toggle(False),
    PreviewComponentNumbers=Toggle(False),
    PreviewNodeNumbers=Toggle(False),
    PreviewElementNumbers=Toggle(False),
    PreviewLoadValues=Toggle(False),
    TextSizeFactor="1",
    GraphicSizeFactor="1",
    DeformationFactor="100000")
