# Grasshopper definition mkraska_Pillow.gh (Grasshopper 0.9.76)
# plug-ins: GuanacoComponents

# ----
# Set Gmsh & CCX path
# (otherwise GH libraries scanned)
panel = Panel("yourCCXDirectory\ccx.exe")
ccxpath = CCXPath(Path=panel)
gmshpath = GmshPath(Path="yourGmshDirectory\gmsh.exe")

supporttype = SupportType({"DX": 1, "DY": 2, "DZ": 3, "RX": 4, "RY": 5, "RZ": 6, "FP": 100}, selected=["DX", "RY"])
supporttype_2 = SupportType({"DX": 1, "DY": 2, "DZ": 3, "RX": 4, "RY": 5, "RZ": 6, "FP": 100}, selected=["DY", "RX"])
supporttype_3 = SupportType({"DX": 1, "DY": 2, "DZ": 3, "RX": 4, "RY": 5, "RZ": 6, "FP": 100}, selected=["DZ", "RX", "RY"])
rectangle = Rectangle(Plane=PlaneXY(0, 0, 0), XSize=Domain(0, 100), YSize=Domain(0, 100), Radius=0)  # -> Rectangle, Length
geo = Geometry(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)
geo_2 = Geometry([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])
geo_3 = Geometry(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)
fe2dtype = FE2DType({"Shell": 0, "Membrane": 1, "PlaneStress": 2, "PlaneStrain": 3}, selected="Shell")
materialisotropic = MaterialIsotropic(Name="sheet", E="200", V="0.3", Density="0")
support = Support(Geometry=flatten(geo_3), SupportType=supporttype, SupportName="Nx")
support_2 = Support(Geometry=flatten(geo), SupportType=supporttype_2, SupportName="Ny")
support_3 = Support(Geometry=flatten(geo_2), SupportType=supporttype_3, SupportName="Nouter")

boundary = BoundarySurfaces(Edges=rectangle.Rectangle)
createpanel = CreatePanel(Surface=boundary, Thickness="0.5", Material=materialisotropic, FEType=fe2dtype)

# ----
# Create model
panel_2 = Panel("<SetDirectoryAndConnect>")
buildmodel = BuildModel(Name="mkraska_pillow", Components=createpanel, Tolerance="0.1")

pressureload = PressureLoad(Surfaces=boundary, LoadValue="0.001")

meshalgorithm = MeshAlgorithm({"MeshAdapt": 1, "Automatic": 2, "Delaunay": 5, "Frontal": 6, "Bamg": 7, "DelQuad": 8, "Pack": 9}, selected="DelQuad")
element2dshape = Element2DShape({"Tri": 0, "Quad": 1}, selected="Quad")
toggle = BooleanToggle(True)
gmshparams = GmshParams(
    ElementShape=element2dshape,
    MeshingAlgorithm=meshalgorithm,
    MaximumCharacteristicEdgeLength="5",
    SecondOrderElements=Toggle(True),
    NumberOfSmoothingSteps="5",
    HighOrderOptimizationIfTrue=Toggle(False),
    OptimizationThreshold="0",
    UnifyFaceNormalsIfTrue=True)

gmshelements = GmshElements(
    RunMeshingProcess=Toggle(False),
    Model=buildmodel,
    GmshParameters=gmshparams,
    ReducedIntegrationElementsAreCreatedIfTrue=Toggle(True))

setbcs = SetBCs(Model=gmshelements, Loads=pressureload, Supports=flatten([support, support_2, support_3]))

# ----
# Preview the model
number_slider = Slider(1, range=0..5)
modelpreview = ModelPreview(
    Model=setbcs,
    PreviewNodes=Toggle(False),
    PreviewThickness=Toggle(False),
    PreviewEdges=Toggle(True),
    PreviewLCS=Toggle(False),
    PreviewLoads=Toggle(False),
    PreviewSupports=Toggle(True),
    PreviewComponentNumbers=Toggle(False),
    PreviewNodeNumbers=Toggle(False),
    PreviewElementNumbers=Toggle(False),
    PreviewLoadValues=Toggle(False),
    TextSizeFactor=number_slider,
    GraphicSizeFactor=Slider(1, range=0..1))

# ----
# Run the analysis
toggle_2 = BooleanToggle(True)
ccxsolvemodel = CCXSolveModel(Run=Toggle(False), Model=setbcs, Nonlinear=toggle_2, Threads=4)

# ----
# Preview the results
_0dresulttype = _0DResultType({"None": 0, "dX": 1, "dY": 2, "dZ": 3, "dTotal": 4}, selected="dTotal")
_1dresulttype = _1DResultType({"None": 0, "Fx": 1, "Fy": 2, "Fz": 3, "Mxx": 4, "Myy": 5, "Mzz": 6}, selected="None")
_2dresulttype = _2DResultType({"None": 0, "Sxx": 1, "Syy": 2, "Szz": 3, "Sxy": 4, "Sxz": 5, "Syz": 6, "Exx": 1, "Eyy": 2, "Ezz": 3, "Exy": 4, "Exz": 5, "Eyz": 6}, selected="None")
resultpreview = ResultPreview(
    Model=ccxsolvemodel,
    NodeResultType=_0dresulttype,
    BarResultType=_1dresulttype,
    PanelResultType=_2dresulttype,
    PreviewValues=Toggle(False),
    PreviewNodes=Toggle(True),
    PreviewEdges=Toggle(True),
    Deformed=Toggle(True),
    PreviewLCS=Toggle(False),
    PreviewLoads=Toggle(False),
    PreviewSupports=Toggle(False),
    PreviewComponentNumbers=Toggle(False),
    PreviewNodeNumbers=Toggle(False),
    PreviewElementNumbers=Toggle(False),
    PreviewLoadValues=Toggle(False),
    TextSizeFactor="1",
    GraphicSizeFactor="1",
    DeformationFactor="1")
