# Grasshopper definition mkraska_Streifen.gh (Grasshopper 0.9.76)
# plug-ins: GuanacoComponents

# ----
# Prepare the geometry
panel = Panel("100")
multiplication = Multiplication(A=panel, B=-0.5)
multiplication_2 = Multiplication(A=panel, B=0.5)
pt = ConstructPoint(XCoordinate=multiplication, YCoordinate=0, ZCoordinate=0)
pt_2 = ConstructPoint(XCoordinate=multiplication_2, YCoordinate=0, ZCoordinate=0)

# ----
# Set Gmsh & CCX path
# (otherwise GH libraries scanned)
panel_2 = Panel("yourCCXDirectory\ccx.exe")
ccxpath = CCXPath(Path=panel_2)
gmshpath = GmshPath(Path="yourGmshDirectory\gmsh.exe")

# ----
# Create a bar
panel_3 = Panel("StandardMaterials")
searchlibrary = SearchLibrary(LibraryName=panel_3, Item="Steel")
boxprofile = BoxProfile(Name="1x1Box", Height="1", Width="10", Thickness=0)
ln = Line(StartPoint=pt, EndPoint=pt_2)
createbar = CreateBar(Curve=ln, Profile=boxprofile, Material=searchlibrary, Rotation=0, XOffset=0, YOffset=0)

# ----
# Create simple supports
supporttype = SupportType({"DX": 1, "DY": 2, "DZ": 3, "RX": 4, "RY": 5, "RZ": 6, "FP": 7}, selected=["DX", "DY", "DZ", "RX", "RY", "RZ"])
support = Support(Geometry=flatten(pt), SupportType=supporttype, SupportName="Support")

Y = UnitY(Factor=1)

# ----
# Create nodal moment
panel_4 = Panel("0.305*1e+9")
nodalmoment = NodalMoment(Point=pt_2, Axis=Y, Moment=panel_4)

# ----
# Create equivalent panel
Y_2 = UnitY(Factor="10")
multiplication_3 = Multiplication(A=Y_2, B=0.5)
multiplication_4 = Multiplication(A=Y_2, B=-0.5)
move = Move(Geometry=pt, Motion=[multiplication_3, multiplication_4])  # -> Geometry, Transform
pline = PolyLine(Vertices=move.Geometry, Closed=False)
swp1 = Sweep1(Rail=ln, Sections=pline, Miter=1)
edges = BrepEdges(Brep=swp1)  # -> Naked, Interior, NonManifold
fe2dtype = FE2DType({"Shell": 0, "Membrane": 1, "PlaneStress": 2, "PlaneStrain": 3}, selected="Shell")
boundary = BoundarySurfaces(Edges=edges.Naked)
createpanel = CreatePanel(Surface=boundary, Thickness="1", Material=searchlibrary, FEType=fe2dtype)

panel_5 = Panel("C:\users\pbaran\desktop\kraska")

# ----
# Create model
panel_6 = Panel("mkraska_streifen_beam")
buildmodel = BuildModel(Name=panel_6, Directory=panel_5, Components=createbar, Tolerance="0.1")

# ----
# Mesh the model
meshalgorithm = MeshAlgorithm({"MeshAdapt": 1, "Automatic": 2, "Delaunay": 5, "Frontal": 6, "Bamg": 7, "DelQuad": 8, "Pack": 9}, selected="DelQuad")
element2dshape = Element2DShape({"Tri": 0, "Quad": 1}, selected="Quad")
toggle = BooleanToggle(True)
toggle_2 = BooleanToggle(True)
gmshparams = GmshParams(
    ElementShape=element2dshape,
    MeshingAlgorithm=meshalgorithm,
    MaximumCharacteristicEdgeLength="1",
    SecondOrderElements=Toggle(True),
    NumberOfSmoothingSteps="5",
    HighOrderOptimizationIfTrue=Toggle(False),
    OptimizationThreshold="0",
    UnifyFaceNormalsIfTrue=True)
gmshelements = GmshElements(
    RunMeshingProcess=Toggle(False),
    Model=buildmodel,
    GmshParameters=gmshparams,
    ReducedIntegrationElementsAreCreatedIfTrue=toggle_2)

# ----
# Create model
panel_7 = Panel("mkraska_streifen_shell")
buildmodel_2 = BuildModel(Name=panel_7, Directory=panel_5, Components=createpanel, Tolerance="0.1")

# ----
# Create support
support_2 = Support(Geometry=flatten(pline), SupportType=supporttype, SupportName="Support")

# ----
# Mesh model
toggle_3 = BooleanToggle(False)
gmshelements_2 = GmshElements(
    RunMeshingProcess=toggle_3,
    Model=buildmodel_2,
    GmshParameters=gmshparams,
    ReducedIntegrationElementsAreCreatedIfTrue=toggle_2)

# ----
# Set load manually: build file, overwrite with predefined rotation and then run from file
setbcs = SetBCs(Model=gmshelements, Supports=support)
ccxbuildfile = CCXBuildFile(Run=Toggle(False), Model=setbcs, Nonlinear=Toggle(True))  # -> Model, FilePath
panel_8 = Panel("""*NSET,NSET=rot
2
*BOUNDARY
rot,5,5,0.174533""")
file = ReadFile(File=ccxbuildfile.FilePath, PerLineParse=True)
ins = InsertItems(List=file, Item=panel_8, Indices="332", Wrap=True)
panel_9 = Panel(ins)
ccxrunfromfile = CCXRunFromFile(Run=Toggle(False), Model=ccxbuildfile.Model, Threads=8)

setbcs_2 = SetBCs(Model=gmshelements_2, Loads=nodalmoment, Supports=support_2)

# ----
# Preview the model
number_slider = Slider(1, range=0..5)
modelpreview = ModelPreview(
    Model=setbcs_2,
    PreviewNodes=Toggle(True),
    PreviewThickness=Toggle(False),
    PreviewEdges=Toggle(True),
    PreviewLCS=Toggle(False),
    PreviewLoads=Toggle(True),
    PreviewSupports=Toggle(True),
    PreviewComponentNumbers=Toggle(False),
    PreviewNodeNumbers=Toggle(False),
    PreviewElementNumbers=Toggle(False),
    PreviewLoadValues=Toggle(True),
    TextSizeFactor=number_slider,
    GraphicSizeFactor=Slider(1, range=0..1))

# ----
# Run the analysis - automatic
setbcs_3 = SetBCs(Model=gmshelements, Loads=nodalmoment, Supports=support)
ccxsolvemodel = CCXSolveModel(Run=Toggle(False), Model=setbcs_3, Nonlinear=Toggle(True), Threads=4)

# ----
# Run the analysis - panel
# Crashing due to CCX bug?
toggle_4 = BooleanToggle(True)
ccxsolvemodel_2 = CCXSolveModel(Run=Toggle(False), Model=setbcs_2, Nonlinear=toggle_4, Threads=4)

# ----
# Preview the model
number_slider_2 = Slider(1, range=0..5)
modelpreview_2 = ModelPreview(
    Model=setbcs_3,
    PreviewNodes=Toggle(True),
    PreviewThickness=Toggle(True),
    PreviewEdges=Toggle(False),
    PreviewLCS=Toggle(False),
    PreviewLoads=Toggle(True),
    PreviewSupports=Toggle(True),
    PreviewComponentNumbers=Toggle(False),
    PreviewNodeNumbers=Toggle(False),
    PreviewElementNumbers=Toggle(False),
    PreviewLoadValues=Toggle(True),
    TextSizeFactor=number_slider_2,
    GraphicSizeFactor=Slider(1, range=0..1))

# ----
# Preview the results
_0dresulttype = _0DResultType({"None": 0, "dX": 1, "dY": 2, "dZ": 3, "dTotal": 4}, selected="dZ")
_1dresulttype = _1DResultType({"None": 0, "Fx": 1, "Fy": 2, "Fz": 3, "Mxx": 4, "Myy": 5, "Mzz": 6}, selected="Myy")
_2dresulttype = _2DResultType({"None": 0, "Sxx": 1, "Syy": 2, "Szz": 3, "Sxy": 4, "Sxz": 5, "Syz": 6, "Exx": 1, "Eyy": 2, "Ezz": 3, "Exy": 4, "Exz": 5, "Eyz": 6}, selected="None")
resultpreview = ResultPreview(
    Model=ccxrunfromfile,
    NodeResultType=_0dresulttype,
    BarResultType=_1dresulttype,
    PanelResultType=_2dresulttype,
    PreviewValues=Toggle(True),
    PreviewNodes=Toggle(False),
    PreviewEdges=Toggle(False),
    Deformed=Toggle(True),
    PreviewLCS=Toggle(False),
    PreviewLoads=Toggle(False),
    PreviewSupports=Toggle(False),
    PreviewComponentNumbers=Toggle(False),
    PreviewNodeNumbers=Toggle(False),
    PreviewElementNumbers=Toggle(False),
    PreviewLoadValues=Toggle(False),
    TextSizeFactor="1",
    GraphicSizeFactor="2",
    DeformationFactor="1")

# ----
# Preview the results
_0dresulttype_2 = _0DResultType({"None": 0, "dX": 1, "dY": 2, "dZ": 3, "dTotal": 4}, selected="dZ")
_1dresulttype_2 = _1DResultType({"None": 0, "Fx": 1, "Fy": 2, "Fz": 3, "Mxx": 4, "Myy": 5, "Mzz": 6}, selected="None")
_2dresulttype_2 = _2DResultType({"None": 0, "Sxx": 1, "Syy": 2, "Szz": 3, "Sxy": 4, "Sxz": 5, "Syz": 6, "Exx": 1, "Eyy": 2, "Ezz": 3, "Exy": 4, "Exz": 5, "Eyz": 6}, selected="Sxx")
resultpreview_2 = ResultPreview(
    Model=ccxsolvemodel_2,
    NodeResultType=_0dresulttype_2,
    BarResultType=_1dresulttype_2,
    PanelResultType=_2dresulttype_2,
    PreviewValues=Toggle(True),
    PreviewNodes=Toggle(False),
    PreviewEdges=Toggle(False),
    Deformed=Toggle(True),
    PreviewLCS=Toggle(False),
    PreviewLoads=Toggle(False),
    PreviewSupports=Toggle(False),
    PreviewComponentNumbers=Toggle(False),
    PreviewNodeNumbers=Toggle(False),
    PreviewElementNumbers=Toggle(False),
    PreviewLoadValues=Toggle(False),
    TextSizeFactor="1",
    GraphicSizeFactor="2",
    DeformationFactor="1")

# ----
# Preview the results
_0dresulttype_3 = _0DResultType({"None": 0, "dX": 1, "dY": 2, "dZ": 3, "dTotal": 4}, selected="dZ")
_1dresulttype_3 = _1DResultType({"None": 0, "Fx": 1, "Fy": 2, "Fz": 3, "Mxx": 4, "Myy": 5, "Mzz": 6}, selected="Myy")
_2dresulttype_3 = _2DResultType({"None": 0, "Sxx": 1, "Syy": 2, "Szz": 3, "Sxy": 4, "Sxz": 5, "Syz": 6, "Exx": 1, "Eyy": 2, "Ezz": 3, "Exy": 4, "Exz": 5, "Eyz": 6}, selected="None")
resultpreview_3 = ResultPreview(
    Model=ccxsolvemodel,
    NodeResultType=_0dresulttype_3,
    BarResultType=_1dresulttype_3,
    PanelResultType=_2dresulttype_3,
    PreviewValues=Toggle(True),
    PreviewNodes=Toggle(True),
    PreviewEdges=Toggle(False),
    Deformed=Toggle(True),
    PreviewLCS=Toggle(False),
    PreviewLoads=Toggle(False),
    PreviewSupports=Toggle(False),
    PreviewComponentNumbers=Toggle(False),
    PreviewNodeNumbers=Toggle(False),
    PreviewElementNumbers=Toggle(False),
    PreviewLoadValues=Toggle(False),
    TextSizeFactor="1",
    GraphicSizeFactor="2",
    DeformationFactor="1")
